% Simulink data dictionary Clutch_Datadictionary.sldd

R = 1
muk = 1
le = 1
bv = 1
mus = 1.5
be = 2
lv = 5

Fn = [0 0
 1 0.8
 2 1.6
 3 1.6
 4 1.6
 5 1.6
 6 0.8
 7 0
 8 0
 9 0
 10 0]

Tin = [1 2
 2 2
 3 2
 4 2
 5 2
 6 0
 7 0
 8 0
 9 0
 10 0]

FnCopy = 0
f1 = [1; 6; 11; 16; 21; 26; 31; 36; 41; 46; 51]